# Grasshopper definition TopologyBrepEdge.gh (Grasshopper 1.0.7)
# plug-ins: Sandbox Topology

brep = Brep(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)
brep_2 = Brep(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)
merge = Merge(Data1=brep, Data2=brep_2)
brep_3 = Brep(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)
brep_4 = Slider(0, range=0..1)
edge = Slider(6, range=0..22)
brep_5 = Brep(flatten(merge))
debrep = DeconstructBrep(Brep=brep_5)  # -> simplify(Faces), Edges, Vertices
concat = Concatenate(FragmentA=brep_4, FragmentC=";", FragmentB=edge)
brep_topo_edge = BrepTopologyEdge(Breps=brep_5)  # -> ListOfEdgeCurves, FaceEdgeStructure, EdgeFaceStructure
pcen = PolygonCenter(Polyline=debrep.Faces)  # -> CenterV, CenterE, CenterA
eval = EvaluateLength(Curve=debrep.Edges, Length=0.5, Normalized=True)  # -> Point, Tangent, Parameter
branch = TreeBranch(Tree=brep_topo_edge.EdgeFaceStructure, Path=concat, MaintainPaths=True)
ef = Panel(branch)
points = PointList(Points=pcen.CenterV, Tags=True, Lines=False, Size=20)
points_2 = PointList(Points=eval.Point, Tags=True, Lines=False, Size=15)
item = TreeItem(Tree=brep_topo_edge.ListOfEdgeCurves, Path=brep_4, Index=edge, Wrap=True)
item_2 = TreeItem(Tree=debrep.Faces, Path=brep_4, Index=branch, Wrap=True)
pipe = Pipe(Curve=item, Radius=10, Caps=0)
