# Grasshopper definition TopologyBrepEdgeFilter.gh (Grasshopper 1.0.7)
# plug-ins: Sandbox Topology

# © 2013 by Tobias Schwinn
brep = Brep(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)
valency = Slider(1, range=1..6)
debrep = DeconstructBrep(Brep=brep)  # -> Faces, Edges, Vertices

brep_topo = BrepTopology(Brep=brep)  # -> FaceEdgeStructure, EdgeFaceStructure
brep_topo_edge_filter = BrepTopologyEdgeFilter(EdgeList=debrep.Edges, EdgeFaceStructure=brep_topo.EdgeFaceStructure, ValencyFilter=valency)  # -> ListOfEdgeIDs, ListOfEdges

pcen = PolygonCenter(Polyline=debrep.Faces)  # -> CenterV, CenterE, CenterA
eval = EvaluateLength(Curve=debrep.Edges, Length=0.5, Normalized=True)  # -> Point, Tangent, Parameter
pipe = Pipe(Curve=brep_topo_edge_filter.ListOfEdges, Radius=5, Caps=0)
points = PointList(Points=pcen.CenterV, Tags=True, Lines=False, Size=20)
points_2 = PointList(Points=eval.Point, Tags=True, Lines=False, Size=15)
I = Panel(brep_topo_edge_filter.ListOfEdgeIDs)
