# Grasshopper definition TopologyBrepVertex.gh (Grasshopper 1.0.7)
# plug-ins: Sandbox Topology

# © 2025 by Tobias Schwinn
brep = Brep(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)
brep_2 = Brep(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)
merge = Merge(Data1=brep, Data2=brep_2)
brep_3 = Brep(merge)
vertex = Slider(0, range=0..47)
brep_topo_vertex = BrepTopologyVertex(Brep=brep_3)  # -> ListOfVertices, FaceVertexStructure, VertexFaceStructure
debrep = DeconstructBrep(Brep=brep_3)  # -> Faces, Edges, Vertices
pcen = PolygonCenter(Polyline=debrep.Faces)  # -> CenterV, CenterE, CenterA
format = Format(Format="{{*;{0}}}", Culture=127, Data0=vertex)
crv = Curve(debrep.Edges)
split = SplitTree(Data=brep_topo_vertex.VertexFaceStructure, Masks=flatten(format))  # -> Positive, Negative
points = PointList(Points=brep_topo_vertex.ListOfVertices, Tags=True, Lines=False, Size=15)
points_2 = PointList(Points=pcen.CenterV, Tags=True, Lines=False, Size=20)
ef = Panel(split.Positive)
item = ListItem(List=debrep.Faces, Index=split.Positive, Wrap=True)
item_2 = ListItem(List=brep_topo_vertex.ListOfVertices, Index=vertex, Wrap=True)
sph = Sphere(Base=item_2, Radius=15)
