# Grasshopper definition TopologyLine.gh (Grasshopper 1.0.7)
# plug-ins: Sandbox Topology

crv = Curve([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])
# © 2025 by Tobias Schwinn
crv_2 = Curve([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])
flatten = FlattenTree(Tree=crv_2, Path="{0}")
flatten_2 = FlattenTree(Tree=crv, Path="{1}")
merge = Merge(Data1=flatten, Data2=flatten_2)
line = Line(merge)
edge = Slider(0, range=0..47)
eval = EvaluateLength(Curve=line, Length=0.5, Normalized=True)  # -> Point, Tangent, Parameter
linetopoidx = LineTopologyIndex(ListOfLines=line, Tolerance=0.001)  # -> ListOfPoints, LinePointStructure, PointPointStructure, PointLineStructure
tstat = TreeStatistics(Tree=line)  # -> Paths, Length, Count
dpath = DeconstructPath(Branch=tstat.Paths)
crossref = CrossReference(ListA=dpath, ListB=edge, CrossMode=1)  # -> ListA, ListB
points = PointList(Points=eval.Point, Tags=True, Lines=False, Size=7)
points_2 = PointList(Points=linetopoidx.ListOfPoints, Tags=True, Lines=False, Size=10)
merge_2 = Merge(Data1=crossref.ListA, Data2=crossref.ListB)
path = ConstructPath(Indices=merge_2)
branch = TreeBranch(Tree=linetopoidx.PointPointStructure, Path=path, MaintainPaths=True)
branch_2 = TreeBranch(Tree=linetopoidx.PointLineStructure, Path=path, MaintainPaths=True)
item = ListItem(List=linetopoidx.ListOfPoints, Index=branch, Wrap=True)
item_2 = ListItem(List=line, Index=branch_2, Wrap=True)
pp = Panel(branch_2)
sph = Sphere(Base=item, Radius=10)
pipe = Pipe(Curve=item_2, Radius=2, Caps=0)
