# Grasshopper definition TopologyLineFilter.gh (Grasshopper 1.0.7)
# plug-ins: Sandbox Topology

# "Select every vertex that is connected to N lines."
crv = Curve([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])
# © 2025 by Tobias Schwinn
crv_2 = Curve([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])
flatten = FlattenTree(Tree=crv_2, Path="{0}")
flatten_2 = FlattenTree(Tree=crv, Path="{1}")
merge = Merge(Data1=flatten, Data2=flatten_2)
line = Line(merge)
eval = EvaluateLength(Curve=line, Length=0.5, Normalized=True)  # -> Point, Tangent, Parameter
poly_topo_edge = PolygonTopologyEdge(Tolerance=0.001)  # -> ListOfEdges, LoopEdgeStructure, EdgeLoopStructure
poly_topo_point = PolygonTopologyPoint(Tolerance=0.001)  # -> ListOfPoints, LoopPointStructure, PointLoopStructure
points = PointList(Points=eval.Point, Tags=True, Lines=False, Size=15)
valency = Slider(3, range=1..6)
poly_topo_point_filter = PolygonTopologyPointFilter(ValencyFilter=1)  # -> ListOfPointIDs, ListOfPoints
poly_topo_edge_filter = PolygonTopologyEdgeFilter(ValencyFilter=1)  # -> ListOfEdgeIDs, ListOfEdges

linetopoidx = LineTopologyIndex(ListOfLines=line, Tolerance=0.001)  # -> ListOfPoints, LinePointStructure, PointPointStructure, PointLineStructure

pshift = ShiftPaths(Data=linetopoidx.LinePointStructure, Offset=-1)
points_2 = PointList(Points=linetopoidx.ListOfPoints, Tags=True, Lines=False, Size=10)
item = ListItem(List=linetopoidx.ListOfPoints, Index=pshift, Wrap=True)
unflatten = UnflattenTree(Tree=item, Guide=linetopoidx.LinePointStructure)
item_2 = ListItem(List=unflatten, Index=0, Wrap=True)  # -> Item, Item1
pp = Panel(unflatten)
ln = Line(StartPoint=item_2.Item, EndPoint=item_2.Item1)
pshift_2 = ShiftPaths(Data=ln, Offset=-1)
pshift_3 = ShiftPaths(Data=linetopoidx.PointLineStructure, Offset=-1)
item_3 = ListItem(List=pshift_2, Index=pshift_3, Wrap=True)
unflatten_2 = UnflattenTree(Tree=item_3, Guide=linetopoidx.PointLineStructure)

line_filter = LineTopologyFilter(ListOfPoints=linetopoidx.ListOfPoints, PointLineStructure=unflatten_2, ValencyFilter=valency)  # -> ListOfPoints, LineStructure

pipe = Pipe(Curve=line_filter.LineStructure, Radius=5, Caps=0)
sph = Sphere(Base=line_filter.ListOfPoints, Radius=20)
viewer = ParamViewer(unflatten_2)
