# Grasshopper definition TopologyMeshEdge.gh (Grasshopper 0.9.56)
# plug-ins: MeshEdit Components, Sandbox, Weaverbird

mesh = Mesh(<mesh referenced from the Rhino model>)
edge = Slider(27, range=0..47)
face = Slider(27, range=0..47)
mesh_topo_edge = MeshTopologyEdge(Mesh=mesh)  # -> ListOfEdges, FaceFaceStructure, EdgeFaceStructure
wbfacepolys = WeaverbirdsFacePolylines(Mesh=mesh)
explode = MeshExplode(Mesh=mesh, Interpolate=False)
pcen = PolygonCenter(Polyline=wbfacepolys)  # -> CenterV, CenterE
eval = EvaluateLength(Curve=mesh_topo_edge.ListOfEdges, Length=0.5, Normalized=True)  # -> Point, Tangent, Parameter
branch = TreeBranch(Tree=mesh_topo_edge.EdgeFaceStructure, Path=edge, MaintainPaths=True)
branch_2 = TreeBranch(Tree=mesh_topo_edge.FaceFaceStructure, Path=face, MaintainPaths=True)
item = ListItem(List=explode, Index=face, Wrap=True)
item_2 = ListItem(List=explode, Index=branch_2, Wrap=True)
item_3 = ListItem(List=mesh_topo_edge.ListOfEdges, Index=edge, Wrap=True)
item_4 = ListItem(List=explode, Index=branch, Wrap=True)
ff = Panel(branch)
points = PointList(Points=eval.Point, Tags=True, Lines=False, Size=12)
points_2 = PointList(Points=pcen.CenterV, Tags=True, Lines=False, Size=20)
pipe = Pipe(Curve=item_3, Radius=5, Caps=0)
