# Grasshopper definition TopologyMeshEdgeFilter.gh (Grasshopper 0.9.56)
# plug-ins: Sandbox, Weaverbird

mesh = Mesh(<mesh referenced from the Rhino model>)
valency = Slider(2, range=1..6)

mesh_topo_edge = MeshTopologyEdge(Mesh=mesh)  # -> ListOfEdges, FaceFaceStructure, EdgeFaceStructure
mesh_topo_edge_filter = MeshTopologyEdgeFilter(EdgeList=mesh_topo_edge.ListOfEdges, EdgeFaceStructure=mesh_topo_edge.EdgeFaceStructure, ValencyFilter=valency)  # -> ListOfEdgeIDs, ListOfEdges

wbfacepolys = WeaverbirdsFacePolylines(Mesh=mesh)
pcen = PolygonCenter(Polyline=wbfacepolys)  # -> CenterV, CenterE
eval = EvaluateLength(Curve=mesh_topo_edge.ListOfEdges, Length=0.5, Normalized=True)  # -> Point, Tangent, Parameter
pipe = Pipe(Curve=mesh_topo_edge_filter.ListOfEdges, Radius=5, Caps=0)
points = PointList(Points=pcen.CenterV, Tags=True, Lines=False, Size=20)
points_2 = PointList(Points=eval.Point, Tags=True, Lines=False, Size=15)
I = Panel(mesh_topo_edge_filter.ListOfEdgeIDs)
