# Grasshopper definition TopologyMeshVertexFilter.gh (Grasshopper 1.0.7)
# plug-ins: Sandbox Topology, Weaverbird, MeshEdit Components

# © 2013 by Tobias Schwinn
mesh = Mesh(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)
valency = Slider(5, range=1..7)

mesh_topo_vertex = MeshTopologyVertex(Mesh=mesh)  # -> ListOfMeshVertices, VertexVertexStructure, VertexFaceStructure
mesh_topo_vertex_filter = MeshTopologyVertexFilter(
    VertexList=mesh_topo_vertex.ListOfMeshVertices,
    VertexFaceStructure=mesh_topo_vertex.VertexFaceStructure,
    ValencyFilter=valency)  # -> ListOfVertexIDs, ListOfVertices

wbfacepolys = WeaverbirdsFacePolylines(Mesh=mesh)
explode = MeshExplode(Mesh=mesh, Interpolate=False)
pcen = PolygonCenter(Polyline=wbfacepolys)  # -> CenterV, CenterE, CenterA
V = Panel(mesh_topo_vertex_filter.ListOfVertexIDs)
branch = TreeBranch(Tree=mesh_topo_vertex.VertexFaceStructure, Path=mesh_topo_vertex_filter.ListOfVertexIDs, MaintainPaths=True)
points = PointList(Points=pcen.CenterV, Tags=True, Lines=False, Size=20)
points_2 = PointList(Points=mesh_topo_vertex.ListOfMeshVertices, Tags=True, Lines=False, Size=15)
sph = Sphere(Base=mesh_topo_vertex_filter.ListOfVertices, Radius=15)
item = ListItem(List=explode, Index=branch, Wrap=True)
