# Grasshopper definition TopologyPolyEdge.gh (Grasshopper 1.0.7)
# plug-ins: Sandbox Topology, LunchBox

crv = Curve([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])
crv_2 = Curve([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])
flatten = FlattenTree(Tree=crv_2, Path="{0}")
flatten_2 = FlattenTree(Tree=crv, Path="{1}")
point = Slider(9, range=0..47)
number_slider = Slider(0, range=0..1)
crv_3 = Curve([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])
merge = Merge(Data1=flatten, Data2=flatten_2)
crv_4 = Curve(merge)
concat = Concatenate(FragmentA=number_slider, FragmentC=";", FragmentB=point)
poly_edge_topo = PolygonEdgeTopology(PolygonNetwork=crv_4, Tolerance=Slider(0.001, range=0..1))  # -> OrderedListOfEdges, EdgeIndecesOrderedByFaceIndex, FaceIndecesOrderedByEdgeIndex
path = DataPath(concat)
pcen = PolygonCenter(Polyline=crv_4)  # -> CenterV, CenterE, CenterA
eval = EvaluateLength(Curve=poly_edge_topo.OrderedListOfEdges, Length=0.5, Normalized=True)  # -> Point, Tangent, Parameter
branch = TreeBranch(Tree=poly_edge_topo.FaceIndecesOrderedByEdgeIndex, Path=path, MaintainPaths=True)
points = PointList(Points=eval.Point, Tags=True, Lines=False, Size=15)
points_2 = PointList(Points=pcen.CenterV, Tags=True, Lines=False, Size=20)
item = TreeItem(Tree=crv_4, Path=number_slider, Index=branch, Wrap=True)
item_2 = TreeItem(Tree=poly_edge_topo.OrderedListOfEdges, Path=number_slider, Index=point, Wrap=True)
patch = PatchSurface(EdgeCurves=graft(item), U=5, V=5, Tolerance=0.001)
pipe = Pipe(Curve=item_2, Radius=10, Caps=0)
