# Grasshopper definition TopologyPolyPointFilter.gh (Grasshopper 0.9.56)
# plug-ins: Sandbox

tolerance = Slider(0.001, range=0.001..1)
valency = Slider(3, range=1..6)
crv = Curve([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])
pcen = PolygonCenter(Polyline=crv)  # -> CenterV, CenterE

topology = PolygonTopology(ListOfPolylines=crv, Tolerance=tolerance)  # -> ListOfPoints, LoopPointStructure, PointLoopCollection
fpolyv = FilterPolygonVertices(PointList=topology.ListOfPoints, PointLoopStructure=topology.PointLoopCollection, ValencyFilter=valency)  # -> ListOfPointIDs, ListOfPoints

points = PointList(Points=pcen.CenterV, Tags=True, Lines=False, Size=20)
points_2 = PointList(Points=topology.ListOfPoints, Tags=True, Lines=False, Size=15)
sph = Sphere(Base=fpolyv.ListOfPoints, Radius=20)
I = Panel(fpolyv.ListOfPointIDs)
